# Grasshopper definition Test1.gh (Grasshopper 1.0.8)

number_slider = Slider(10, range=0..10)
number_slider_2 = Slider(3, range=0..10)
Z = UnitZ(Factor="12")
move = Move(Motion=Z)  # -> Geometry, Transform
rotate = Rotate(Angle=degrees(Slider(9, range=0..100)), Plane=PlaneXY(0, 0, 0))  # -> Geometry, Transform
c_script = CSharpScript(Size=number_slider_2)  # -> out, oSLBlockPair; inputs Size: Double
# ---------- c_script: C# ----------
// Grasshopper Script Instance
#region Usings
#r "/Volumes/File/IBOIS/Courses/TimberResearch/SLBlockResearch/Program/VScode/bin/Debug/net7.0/VScode.dll"
using System;
using System.Linq;
using System.Collections;
using System.Collections.Generic;
using System.Drawing;
using Block;
using Rhino;
using Rhino.Geometry;

using Grasshopper;
using Grasshopper.Kernel;
using Grasshopper.Kernel.Data;
using Grasshopper.Kernel.Types;
#endregion

public class Script_Instance : GH_ScriptInstance
{
    #region Notes
    /* 
      Members:
        RhinoDoc RhinoDocument
        GH_Document GrasshopperDocument
        IGH_Component Component
        int Iteration

      Methods (Virtual & overridable):
        Print(string text)
        Print(string format, params object[] args)
        Reflect(object obj)
        Reflect(object obj, string method_name)
    */
    #endregion

    private void RunScript(double Size, ref object oSLBlockPair)
    {
        // Write your logic here
        var SL = new SLBlockPair(Size);
        SL.SetIdenifier("I");
        oSLBlockPair = SL;
    }
}
# ---------- end c_script ----------
c_script_2 = CSharpScript(Size=number_slider_2)  # -> TSStrings; inputs Size: Double
# ---------- c_script_2: C# ----------
// Grasshopper Script Instance
#region Usings
using System;
using System.Linq;
using System.Collections;
using System.Collections.Generic;
using System.Drawing;

using Rhino;
using Rhino.Geometry;

using Grasshopper;
using Grasshopper.Kernel;
using Grasshopper.Kernel.Data;
using Grasshopper.Kernel.Types;
#endregion

public class Script_Instance : GH_ScriptInstance
{
    #region Notes
    /* 
      Members:
        RhinoDoc RhinoDocument
        GH_Document GrasshopperDocument
        IGH_Component Component
        int Iteration

      Methods (Virtual & overridable):
        Print(string text)
        Print(string format, params object[] args)
        Reflect(object obj)
        Reflect(object obj, string method_name)
    */
    #endregion

    private void RunScript(double Size, ref object TSStrings)
    {
        // Write your logic here
        //H T S D A Y
        var TStrings = new List<string>{
            $"{Size * 2} 0 0 180 0 0", 
            $"{Size} {Size} {Size} 180 0 -90",
            $"{Size} {-Size} {-Size}, 0 0 -90",
            $"{Size * 2} 0 {Size} 0 0 0",
            $"{Size} {Size} 0 0 0 -90",
            $"{-Size} {Size} {-2 * Size} 0 0 90"
        };
        TSStrings = TStrings;
    }
    private Transform TSParser(string TText)
    {
        var Num = TText.Split(' ').Select(x => {
            if(!double.TryParse(x, out var Result))
            {
                throw new Exception($"Parsing {x} into number was failed");
            }
            return Result;
        }).ToList();
        if(Num.Count > 6) throw new Exception("Input format error");
        var Vec = new Vector3d(Num[0], Num[1], Num[2]);
        var RotX = Transform.Rotation(Num[4] / 180 * Math.PI, Vector3d.XAxis, Point3d.Origin);
        var RotY = Transform.Rotation(Num[5] / 180 * Math.PI, Vector3d.YAxis, Point3d.Origin);
        var RotZ = Transform.Rotation(Num[6] / 180 * Math.PI, Vector3d.ZAxis, Point3d.Origin);

        return RotX * RotY * RotZ * Transform.Translation(Vec);

    }
}
# ---------- end c_script_2 ----------
c_script_3 = CSharpScript(Size=number_slider_2)  # -> out, oSLBlock; inputs Size: Double
# ---------- c_script_3: C# ----------
// Grasshopper Script Instance
#region Usings
#r "/Volumes/File/IBOIS/Courses/TimberResearch/SLBlockResearch/Program/VScode/bin/Debug/net7.0/VScode.dll"
using System;
using System.Linq;
using System.Collections;
using System.Collections.Generic;
using System.Drawing;
using Block;
using Rhino;
using Rhino.Geometry;

using Grasshopper;
using Grasshopper.Kernel;
using Grasshopper.Kernel.Data;
using Grasshopper.Kernel.Types;
#endregion

public class Script_Instance : GH_ScriptInstance
{
    #region Notes
    /* 
      Members:
        RhinoDoc RhinoDocument
        GH_Document GrasshopperDocument
        IGH_Component Component
        int Iteration

      Methods (Virtual & overridable):
        Print(string text)
        Print(string format, params object[] args)
        Reflect(object obj)
        Reflect(object obj, string method_name)
    */
    #endregion

    private void RunScript(double Size, ref object oSLBlock)
    {
        // Write your logic here
        var SL = new SLBlock(Size);
        SL.SetIdenifier("I");
        oSLBlock = SL;
    }
}
# ---------- end c_script_3 ----------
c_script_4 = CSharpScript(Name="I")  # -> out, Token; inputs Name: String
# ---------- c_script_4: C# ----------
// Grasshopper Script Instance
#region Usings
#r "/Volumes/File/IBOIS/Courses/TimberResearch/SLBlockResearch/Program/VScode/bin/Debug/net7.0/VScode.dll"
using System;
using System.Linq;
using System.Collections;
using System.Collections.Generic;
using System.Drawing;

using Rhino;
using Rhino.Geometry;

using Block;
using Grammar;

using Grasshopper;
using Grasshopper.Kernel;
using Grasshopper.Kernel.Data;
using Grasshopper.Kernel.Types;
#endregion

public class Script_Instance : GH_ScriptInstance
{
    #region Notes
    /* 
      Members:
        RhinoDoc RhinoDocument
        GH_Document GrasshopperDocument
        IGH_Component Component
        int Iteration

      Methods (Virtual & overridable):
        Print(string text)
        Print(string format, params object[] args)
        Reflect(object obj)
        Reflect(object obj, string method_name)
    */
    #endregion

    private void RunScript(string Name, ref object Token)
    {
        // Write your logic here
        Token = new IDToken(Name, "I");
    }
}
# ---------- end c_script_4 ----------
c_script_5 = CSharpScript(Name="H", TS=move.Transform)  # -> out, Token; inputs Name: String, TS: Transform
# ---------- c_script_5: C# ----------
// Grasshopper Script Instance
#region Usings
#r "/Volumes/File/IBOIS/Courses/TimberResearch/SLBlockResearch/Program/VScode/bin/Debug/net7.0/VScode.dll"
using System;
using System.Linq;
using System.Collections;
using System.Collections.Generic;
using System.Drawing;

using Rhino;
using Rhino.Geometry;
using Grammar;
using Block;
using Grasshopper;
using Grasshopper.Kernel;
using Grasshopper.Kernel.Data;
using Grasshopper.Kernel.Types;
#endregion

public class Script_Instance : GH_ScriptInstance
{
    #region Notes
    /* 
      Members:
        RhinoDoc RhinoDocument
        GH_Document GrasshopperDocument
        IGH_Component Component
        int Iteration

      Methods (Virtual & overridable):
        Print(string text)
        Print(string format, params object[] args)
        Reflect(object obj)
        Reflect(object obj, string method_name)
    */
    #endregion

    private void RunScript(string Name, Transform TS, ref object Token)
    {
        // Write your logic here
        Token = new TransformationToken(Name, TS);
    }
}
# ---------- end c_script_5 ----------
panel = Panel("""H
T
S
D
A
Y""")
panel_2 = Panel("I H I")
panel_3 = Panel(c_script_2)
panel_4 = Panel("H")
c_script_6 = CSharpScript(TSStrings=c_script_2)  # -> TS; inputs TSStrings: String
# ---------- c_script_6: C# ----------
// Grasshopper Script Instance
#region Usings
using System;
using System.Linq;
using System.Collections;
using System.Collections.Generic;
using System.Drawing;

using Rhino;
using Rhino.Geometry;

using Grasshopper;
using Grasshopper.Kernel;
using Grasshopper.Kernel.Data;
using Grasshopper.Kernel.Types;
#endregion

public class Script_Instance : GH_ScriptInstance
{
    #region Notes
    /* 
      Members:
        RhinoDoc RhinoDocument
        GH_Document GrasshopperDocument
        IGH_Component Component
        int Iteration

      Methods (Virtual & overridable):
        Print(string text)
        Print(string format, params object[] args)
        Reflect(object obj)
        Reflect(object obj, string method_name)
    */
    #endregion

    private void RunScript(string TSStrings, ref object TS)
    {
        // Write your logic here
        TS = TSParser(TSStrings);
    }
    private Transform TSParser(string TText)
    {
        var Num = TText.Split(' ').Select(x => {
            if(!double.TryParse(x, out var Result))
            {
                throw new Exception($"Parsing {x} into number was failed");
            }
            return Result;
        }).ToList();
        if(Num.Count > 6) throw new Exception("Input format error");
        var Vec = new Vector3d(Num[0], Num[1], Num[2]);
        var RotX = Transform.Rotation(Num[3] / 180 * Math.PI, Vector3d.XAxis, Point3d.Origin);
        var RotY = Transform.Rotation(Num[4] / 180 * Math.PI, Vector3d.YAxis, Point3d.Origin);
        var RotZ = Transform.Rotation(Num[5] / 180 * Math.PI, Vector3d.ZAxis, Point3d.Origin);

        return RotX * RotY * RotZ * Transform.Translation(Vec);

    }
}
# ---------- end c_script_6 ----------
panel_5 = Panel("i_h cap i^h cap_2 i^h")
c_script_7 = CSharpScript(Name="i_h", t=Slider(0.5, range=0..1))  # -> out, iTransIDToken, a; inputs Name: String, t: Double
# ---------- c_script_7: C# ----------
// Grasshopper Script Instance
#region Usings
#r "/Volumes/File/IBOIS/Courses/TimberResearch/SLBlockResearch/Program/VScode/bin/Debug/net7.0/VScode.dll"
using System;
using System.Linq;
using System.Collections;
using System.Collections.Generic;
using System.Drawing;
using Block;
using Grammar;
using Rhino;
using Rhino.Geometry;

using Grasshopper;
using Grasshopper.Kernel;
using Grasshopper.Kernel.Data;
using Grasshopper.Kernel.Types;
#endregion

public class Script_Instance : GH_ScriptInstance
{
    #region Notes
    /* 
      Members:
        RhinoDoc RhinoDocument
        GH_Document GrasshopperDocument
        IGH_Component Component
        int Iteration

      Methods (Virtual & overridable):
        Print(string text)
        Print(string format, params object[] args)
        Reflect(object obj)
        Reflect(object obj, string method_name)
    */
    #endregion

    private void RunScript(
		string Name,
		double t,
		ref object iTransIDToken,
		ref object a)
    {
        // Write your logic here

        var TranIDT = new TransIDToken(Name, "I", PairLock);
        TranIDT.SetT(t);
        iTransIDToken = TranIDT;
        a = TranIDT.Name;
    }
    private List<Transform> PairLock(IShapeContext context)
    {
        var S = context.blocks.First().Size;
        var R = Transform.Rotation(Math.PI, Vector3d.ZAxis, Point3d.Origin);
        var T = Transform.Translation(new Vector3d(2*S, 0,0));
        return new List<Transform>{Transform.Identity, R * T};
    }
}

 public sealed class TransIDToken: Token
 {
    private double t;
    public override string Name {get;}
    public string Identifier {get;}
    private AdditionalPlacement Add;
    public delegate List<Transform> AdditionalPlacement(IShapeContext context);
    public TransIDToken(string Name, string Identifier, AdditionalPlacement Add)
    {
        t = 0;
        this.Name = Name;
        this.Identifier = Identifier;
        this.Add = Add;
        this.IsCalled = 0;
    }
    public void SetT(double t) => this.t = 1 - t;
    private int IsCalled = 0;
    private List<Color> Cols = new List<Color>{Color.Red, Color.White, Color.Black, Color.Blue};
    public override bool Action(ref IShapeContext context, params object[] args)
    {
        var Pointer = context.PointerTS;
        var PL = Plane.WorldXY;
        PL.Transform(Pointer);
        this.IsCalled++;
        var PlacedVec = PL.ZAxis * context.blocks.First().Size * -4;
        var Col = Cols[IsCalled%4];
        context.shapeInterpreter.cmd += "Move Vector: " + (PlacedVec * t).ToString() + "\n";
        
        var TSVelocity = Transform.Translation( PlacedVec * t);
        var TSAdd = this.Add(context);
        if(context.blocks.Select(x => x.attribute.Identifier).ToList().Contains(this.Identifier))
        {
            
            var ListBlocks = new BlockList<IBlockBase>();
            for(int i = 0; i < TSAdd.Count; i++)
            {
                var GetBlock = context.blocks.Where(b => b.attribute.Identifier == this.Identifier).First().DuplicateBlock();
                GetBlock.Transform(TSVelocity);
                GetBlock.Transform(context.PointerTS);
                GetBlock.Transform(TSAdd[i]);

                ListBlocks.Add((IBlockBase)GetBlock);
            }
            
            foreach(var B in ListBlocks)
            {
                
                context.shapeInterpreter.blocklist.Add((IBlockBase)B);
                context.shapeInterpreter.blocklist.Last().attribute.BlockColor = Col;
            }
            return true;
        }

        return false;
    }
    public override bool Equals(IToken<IShapeContext> other)
    => other != null && other.Name == Name;
 }
# ---------- end c_script_7 ----------
c_script_8 = CSharpScript(Name=panel, TS=c_script_6)  # -> out, Token; inputs Name: String, TS: Transform; same code as c_script_5
panel_6 = Panel(c_script_7.a)
merge = Merge(Data1=c_script_8.Token, Data2=c_script_4.Token, Data3=c_script_7.iTransIDToken)  # -> flatten(Result)
c_script_9 = CSharpScript(iSLBlock=c_script_3.oSLBlock, Tokens=merge, Sentence="i_h H i_h H i_h H i_h A I H i_h H i_h")  # -> out, Blocks, cmd; inputs Tokens: list, Sentence: String
# ---------- c_script_9: C# ----------
// Grasshopper Script Instance
#region Usings
#r "/Volumes/File/IBOIS/Courses/TimberResearch/SLBlockResearch/Program/VScode/bin/Debug/net7.0/VScode.dll"
using System;
using System.Linq;
using System.Collections;
using System.Collections.Generic;
using System.Drawing;

using Rhino;
using Rhino.Geometry;
using Block;
using Grammar;
using Grasshopper;
using Grasshopper.Kernel;
using Grasshopper.Kernel.Data;
using Grasshopper.Kernel.Types;
#endregion

public class Script_Instance : GH_ScriptInstance
{
    #region Notes
    /* 
      Members:
        RhinoDoc RhinoDocument
        GH_Document GrasshopperDocument
        IGH_Component Component
        int Iteration

      Methods (Virtual & overridable):
        Print(string text)
        Print(string format, params object[] args)
        Reflect(object obj)
        Reflect(object obj, string method_name)
    */
    #endregion

    private void RunScript(
		object iSLBlock,
		List<object> Tokens,
		string Sentence,
		ref object Blocks,
		ref object cmd)
    {
        var SL = (IBlockBase) iSLBlock;
        var Interpret = new ShapeInterpreter(SL);
        foreach(Token T in Tokens)
        {
            Interpret.AddToken(T);
        }
        Interpret.SetSentence(Sentence);
        Interpret.Compute();

        Blocks = Interpret.blocklist;
        cmd = Interpret.cmd;
    }
}
# ---------- end c_script_9 ----------
panel_7 = Panel(c_script_9.cmd)
panel_8 = Panel(c_script_9.Blocks)
item = ListItem(List=c_script_6, Index=Slider(3, range=0..5), Wrap=True)
data = Data(c_script_3.oSLBlock)
transform = Transform(Geometry=data, Transform=item)
item_2 = ListItem(List=c_script_9.Blocks, Index=Slider(4, range=0..10), Wrap=True)
c_script_10 = CSharpScript(x=c_script_9.Blocks)  # -> out, a; inputs x: list
# ---------- c_script_10: C# ----------
// Grasshopper Script Instance
#region Usings
#r "/Volumes/File/IBOIS/Courses/TimberResearch/SLBlockResearch/Program/VScode/bin/Debug/net7.0/VScode.dll"
using System;
using System.Linq;
using System.Collections;
using System.Collections.Generic;
using System.Drawing;
using Block;

using Rhino;
using Rhino.Geometry;

using Grasshopper;
using Grasshopper.Kernel;
using Grasshopper.Kernel.Data;
using Grasshopper.Kernel.Types;
#endregion

public class Script_Instance : GH_ScriptInstance
{
    #region Notes
    /* 
      Members:
        RhinoDoc RhinoDocument
        GH_Document GrasshopperDocument
        IGH_Component Component
        int Iteration

      Methods (Virtual & overridable):
        Print(string text)
        Print(string format, params object[] args)
        Reflect(object obj)
        Reflect(object obj, string method_name)
    */
    #endregion

    private void RunScript(List<object> x, object y, ref object a)
    {
        // Write your logic here
        var Group = (BlockList<IBlockBase>) x;
        a = Group.GetType();
    }
}
# ---------- end c_script_10 ----------
panel_10 = Panel(c_script_10.a)
c_script_11 = CSharpScript(Col=ColourSwatch(SwatchColor=RGB(92, 1, 1)))  # inputs Col: Color
# ---------- c_script_11: C# ----------
// Grasshopper Script Instance
#region Usings
#r "/Volumes/File/IBOIS/Courses/TimberResearch/SLBlockResearch/Program/VScode/bin/Debug/net7.0/VScode.dll"
using System;
using System.Linq;
using System.Collections;
using System.Collections.Generic;
using System.Drawing;
using Block;

using Rhino;
using Rhino.Geometry;

using Grasshopper;
using Grasshopper.Kernel;
using Grasshopper.Kernel.Data;
using Grasshopper.Kernel.Types;
#endregion

public class Script_Instance : GH_ScriptInstance
{
    #region Notes
    /* 
      Members:
        RhinoDoc RhinoDocument
        GH_Document GrasshopperDocument
        IGH_Component Component
        int Iteration

      Methods (Virtual & overridable):
        Print(string text)
        Print(string format, params object[] args)
        Reflect(object obj)
        Reflect(object obj, string method_name)
    */
    #endregion

    private void RunScript(object iSL, Color Col)
    {
        // Write your logic here
        if(iSL == null) return;
        var SL = (IBlockBase) iSL;
        SL.attribute.BlockColor = Col;

    }
}
# ---------- end c_script_11 ----------
